# Grasshopper definition hops_test.gh (Grasshopper 1.0.7)
# plug-ins: Hops, Heteroptera

panel = Panel("/Volumes/GoogleDrive/My Drive/2021/coursework_fall_2021/4450_COMPUTATIONAL_DESIGN/final_project/geometric_sound/src/hops_test.py")
number_slider = Slider(2, range=0..5)
geometry_pipeline = GeometryPipeline(
    GroupByLayer=False,
    GroupByType=False,
    IncludeHidden=True,
    IncludeLocked=True,
    LayerFilter="explorer_demo",
    NameFilter="*",
    SublayerFiltering=True,
    TypeFilter=4)
geometry_pipeline_2 = GeometryPipeline(
    GroupByLayer=False,
    GroupByType=False,
    IncludeHidden=True,
    IncludeLocked=True,
    LayerFilter="G",
    NameFilter="*",
    SublayerFiltering=True,
    TypeFilter=4)
network_from_lines = NetworkFromLines(Lines=geometry_pipeline)  # -> PointPointTopology, simplify(ConnectionPointTopology), simplify(flatten(Points)), flatten(Lines)
network_from_lines_2 = NetworkFromLines(Lines=geometry_pipeline_2)  # -> PointPointTopology, simplify(ConnectionPointTopology), simplify(flatten(Points)), flatten(Lines)
cluster = Cluster_2(
    x_coordinate="0.",
    y_coordinate_2="0.",
    y_coordinate="0.",
    z_coordinate_2="0.",
    z_coordinate="0.",
    A=Slider(1.475, range=0..10),
    A_2="0.",
    count_2=number_slider,
    count_4=number_slider,
    B=number_slider,
    count=number_slider,
    count_3=number_slider,
    factor=Slider(0, range=0..10))
network_from_lines_3 = NetworkFromLines(Lines=cluster)  # -> PointPointTopology, simplify(ConnectionPointTopology), simplify(flatten(Points)), flatten(Lines)

points = Data(network_from_lines_2.Points)
edges = Data(network_from_lines_2.ConnectionPointTopology)
lines = Data(network_from_lines_2.Lines)

points_2 = Data(network_from_lines_3.Points)
edges_2 = Data(network_from_lines_3.ConnectionPointTopology)
lines_2 = Data(network_from_lines_3.Lines)

points_3 = Data(network_from_lines.Points)
edges_3 = Data(network_from_lines.ConnectionPointTopology)
lines_3 = Data(network_from_lines.Lines)

value_list = ValueList({"Line": 0, "Triangle": 1, "Grid": 2}, selected="Grid")
data = Data(value_list)

points_4 = StreamFilter(Gate=data, Stream0=points_3, Stream1=points, Stream2=points_2)
lines_4 = StreamFilter(Gate=data, Stream0=lines_3, Stream1=lines, Stream2=lines_2)
edges_4 = StreamFilter(Gate=data, Stream0=edges_3, Stream1=edges, Stream2=edges_2)

points_5 = Data(points_4)
lines_5 = Data(lines_4)
edges_5 = Data(edges_4)

# ----
# controls
set_geometry = BooleanToggle(True)
set_topology = Button()
set_geometry_2 = Button()
speed = Slider(0.381, range=0..4)
note_duration = Slider(0.3, range=0..2)
note_velocity = Slider(0.831, range=0..1)
pause = Button()
start = Button()
reset = Button()
hops = Hops(
    Start=start,
    Pause=pause,
    Reset=reset,
    Speed=speed,
    CacheResultsInMemory=False,
    CacheSolveResults=False,
    RemoteDefinitionLocation="http://127.0.0.1:5000/run_delphi",
    RemoteSolveVersion=(0, 1, 0),
    ShowInput_Enabled=False,
    ShowInput_Path=False,
    SynchronousSolve=True)

trigger = Trigger(Interval=20, TimerInterval=20, Target=hops_2)
hops_2 = Hops(
    CacheResultsInMemory=False,
    CacheSolveResults=False,
    RemoteDefinitionLocation="http://127.0.0.1:5000/delphi_state",
    RemoteSolveVersion=(0, 1, 0),
    ShowInput_Enabled=False,
    ShowInput_Path=False,
    SynchronousSolve=True)
point = Point(hops_2)
panel_3 = Panel(point)
sphere = Sphere(Base=point, Radius=0.2)

# ----
# add oracle
explore_mode = ValueList({"Bounce": 0, "Explode": 1, "Random": 2}, selected="Random")
reverse_edge = BooleanToggle(True)
select_edge = Slider(0, range=0..1)
speed_2 = Slider(1, range=0..4)
edges_6 = Data(edges_5)
curves = Data(lines_5)
cluster_2 = Cluster(list_2=curves, tree=edges_6, list=curves, B=select_edge)
reverse_list = ReverseList(List=cluster_2)
stream_filter = StreamFilter(Gate=reverse_edge, Stream0=cluster_2, Stream1=reverse_list)
add_oracle = Hops(
    Add=Button(),
    Edges=stream_filter,
    Speed=speed_2,
    EndBehavior=explore_mode,
    CacheResultsInMemory=False,
    CacheSolveResults=False,
    RemoteDefinitionLocation="http://127.0.0.1:5000/delphi_add_mite",
    RemoteSolveVersion=(0, 1, 0),
    ShowInput_Enabled=False,
    ShowInput_Path=False,
    SynchronousSolve=True)

edges_7 = Data(simplify(edges_5))
points_6 = Data(points_5)
curves_2 = Data(lines_5)

# ----
# edge_data
data_2 = Data(curves_2)
speed_3 = Slider(3.644, range=0..10)
length = Length(Curve=data_2)
division = Division(A=speed_3, B=length)

# ----
# nodes
point_2 = Point(points_6)
list_length = ListLength(List=point_2)
subtraction = Subtraction(A=list_length, B=1)
range = Range(Domain=subtraction, Steps=subtraction)  # -> flatten(Range)

# ----
# node_data
deconstruct = Deconstruct(Point=points_6)  # -> XComponent, YComponent, ZComponent
entwine = Entwine(Branch00=deconstruct.XComponent, Branch01=deconstruct.YComponent, FlattenInputs=True)

expression = Expression(x=deconstruct.XComponent, y=deconstruct.YComponent, Expression="Sqrt(x² + y²)")

data_3 = Data(expression)

# ----
# tuner
data_4 = Data(data_3)
average = Average(Input=data_4)
expression_2 = Expression(x=data_4, A4=average, scale=Slider(3, range=0..10), Expression="69 + (x - A4) * scale")
tuned_data = Integer(expression_2)

hops_3 = Hops(
    Trigger=set_geometry_2,
    EdgeCurves=curves_2,
    Speed=division,
    Note=tuned_data,
    NoteVelocity=note_velocity,
    Duration=note_duration,
    CacheResultsInMemory=False,
    CacheSolveResults=False,
    RemoteDefinitionLocation="http://127.0.0.1:5000/delphi_update_geometry",
    RemoteSolveVersion=(0, 1, 0),
    ShowInput_Enabled=False,
    ShowInput_Path=False,
    SynchronousSolve=True)
hops_4 = Hops(
    Setup=set_topology,
    Nodes=range,
    Edges=edges_7,
    CacheResultsInMemory=False,
    CacheSolveResults=False,
    RemoteDefinitionLocation="http://127.0.0.1:5000/delphi_setup",
    RemoteSolveVersion=(0, 1, 0),
    ShowInput_Enabled=False,
    ShowInput_Path=False,
    SynchronousSolve=True)

# ==== cluster Cluster
list = ClusterInput()
list_length = ListLength(List=list)
B = ClusterInput()
subtraction = Subtraction(A=list_length, B=1)
multiplication = Multiplication(A=subtraction, B=B)
list_2 = ClusterInput()
tree = ClusterInput()
integer = Integer(multiplication)
list_item = ListItem(List=list_2, Index=integer, Wrap=True)
tree_branch = TreeBranch(Tree=tree, Path=integer, MaintainPaths=True)  # -> flatten(Branch)
pipe = Pipe(Curve=list_item, Radius=0.1, Caps=0)
branch = ClusterOutput(tree_branch)
colour_picker = ColourPicker(PickedColour=RGB(82, 105, 235))
custom_preview = CustomPreview(Geometry=pipe, Material=colour_picker)

# ==== cluster Cluster_2
x_coordinate = ClusterInput()
y_coordinate = ClusterInput()
z_coordinate = ClusterInput()
factor = ClusterInput()
A = ClusterInput()
B = ClusterInput()
y_coordinate_2 = ClusterInput()
z_coordinate_2 = ClusterInput()
A_2 = ClusterInput()
count = ClusterInput()
count_2 = ClusterInput()
count_3 = ClusterInput()
count_4 = ClusterInput()

construct_point = ConstructPoint(XCoordinate=x_coordinate, YCoordinate=y_coordinate, ZCoordinate=z_coordinate)
unit_x = UnitX(Factor=factor)
multiplication = Multiplication(A=A, B=B)
unit_y = UnitY(Factor=multiplication)
addition = Addition(A=A_2, B=multiplication)
construct_point_2 = ConstructPoint(XCoordinate=addition, YCoordinate=y_coordinate_2, ZCoordinate=z_coordinate_2)
line = Line(StartPoint=construct_point, EndPoint=construct_point_2)
move = Move(Geometry=line, Motion=unit_y)  # -> Geometry, Transform
move_2 = Move(Geometry=move.Geometry, Motion=unit_x)  # -> Geometry, Transform
divide_curve = DivideCurve(Curve=move_2.Geometry, Count=count, Kinks=False)  # -> Points, Tangents, Parameters
divide_curve_2 = DivideCurve(Curve=line, Count=count_2, Kinks=False)  # -> Points, Tangents, Parameters
line_2 = Line(StartPoint=divide_curve_2.Points, EndPoint=divide_curve.Points)
list_item = ListItem(List=line_2, Index=0, Wrap=True)  # -> Item1, Item
divide_curve_3 = DivideCurve(Curve=list_item.Item, Count=count_3, Kinks=False)  # -> Points, Tangents, Parameters
divide_curve_4 = DivideCurve(Curve=list_item.Item1, Count=count_4, Kinks=False)  # -> Points, Tangents, Parameters
line_3 = Line(StartPoint=divide_curve_4.Points, EndPoint=divide_curve_3.Points)
merge = Merge(Data1=flatten(line_3), Data2=flatten(line_2))

result = ClusterOutput(merge)
